# Grasshopper definition example.gh (Grasshopper 1.0.7)
# plug-ins: TJADSZY

# https://cdn.discordapp.com/attachments/1087934639081009156/1253296449861587026/nightmare_s._realistic_red_apples_on_a_table_less_reflection_336e3a98-908e-4294-8b04-3902e87217e1.png?ex=66ac0d06&is=66aabb86&hm=12352d0ebaed9729c9550d5ac6bc1855c84846e0ecbccfab6dc4eb42d8fb2d25&
panel = Panel("{\"name\": \"morpheus\",\"job\": \"leader\"}")
post = HTTPPostRequestComponent(Send=Toggle(False), URL="https://reqres.in/api/users", BODY=panel, Timeout=10000)
ar = AiRender(
    Prompt="C:\Users\songziyu\Desktop\11.png",
    File_path_to_hold_the_image="C:\Users\songziyu\Desktop\11.png",
    Named_view_to_render="111",
    Toggle_to_run=Toggle(False))
panel_2 = Panel(post)
image_resource = ImageResource(ar)
