# Grasshopper definition Temp.gh (Grasshopper 1.0.7)
# plug-ins: TJADSZY, RhinoCodePluginGH

crv = Curve(<curve referenced from the Rhino model>)
cp = ControlPoints(Curve=crv)  # -> Points, Weights, Knots
area = Area(Geometry=crv)  # -> Area, Centroid
cull_i = CullIndex(List=cp.Points, Indices=-1, Wrap=True)
cir = Circle(Plane=area.Centroid, Radius=1)
number_slider = Slider(1, range=0..1)
alongcrv = SortAlongCurve(Points=cull_i, Curve=cir)  # -> Points, Indices
crv_2 = Curve([<curve referenced from the Rhino model> x71])
crv_3 = Curve([<curve referenced from the Rhino model> x45])
crv_4 = Curve([<curve referenced from the Rhino model> x35])
gs = GenSchool(
    PlotRatio=number_slider,
    BoundaryPoints=alongcrv.Points,
    PlaygroundS=crv_2,
    PlaygroundM=crv_3,
    PlaygroundL=crv_4,
    DayFactor=number_slider)  # -> Test, Crv
S = Script(x=alongcrv.Points)  # -> out, a; inputs x: list of Point3d
# ---------- S: C# ----------
// Grasshopper Script Instance
using System;
using System.Collections;
using System.Collections.Generic;
using System.Drawing;

using Rhino;
using Rhino.Geometry;

using Grasshopper;
using Grasshopper.Kernel;
using Grasshopper.Kernel.Data;
using Grasshopper.Kernel.Types;
using Rhino.NodeInCode;

public class Script_Instance : GH_ScriptInstance
{
  /* 
    Members:
      RhinoDoc RhinoDocument
      GH_Document GrasshopperDocument
      IGH_Component Component
      int Iteration

    Methods (Virtual & overridable):
      Print(string text)
      Print(string format, params object[] args)
      Reflect(object obj)
      Reflect(object obj, string method_name)
  */
  
  private void RunScript(IEnumerable<Point3d> x, out object a)
  {
    var polyline=Components.FindComponent("PolyLine").Delegate as dynamic;

    Curve tmp = polyline(x, true)[0];
    var area=Components.FindComponent("Area").Delegate as dynamic;
    a = area(tmp)[1];
  }
}
# ---------- end S ----------
pt = Point(gs.Test)
crv_5 = Curve(gs.Crv)
